vi "AM.gvi"   [LabVIEW NXG 3.1.0]
inputs:
  "M_amplitude": f64 = 1
  "M_frequency": f64 = 10
  "M_sample_rate": f64 = 1000
  "M_samples": i32 = 1000
  "C_amplitude": f64 = 1
  "C_frequency": f64 = 10
  "C_sample_rate": f64 = 1000
  "C_samples": i32 = 1000
outputs:
  "message_signal": waveform<f64>
  "carrier_signal": waveform<f64>
  "AM_signal": waveform<f64>
  "AM power spectrum": T1
  "message power spectrum": T1
panel indicators:
  "carrier power spectrum": T1
types:
  T1 = cluster{"f0": f64, "df": f64, "magnitude": f64[]}
uses:
  NI::Analysis::Generation::Sine Waveform.gvi
  NI::Analysis::Measurement::Power Spectral Density for 1 Chan.gvi
diagram:
  call "Sine Waveform.gvi"(sample rate=$C_sample_rate, samples=$C_samples, amplitude=$C_amplitude, frequency=$C_frequency, phase in=90) -> (sine wave=w1)
  $carrier_signal <- w1
  call "Power Spectral Density for 1 Chan.gvi"(signal=w1) -> (power spectral density=w2)
  $"carrier power spectrum" <- w2
  call "Sine Waveform.gvi"(sample rate=$C_sample_rate, samples=$C_samples, amplitude=1, frequency=$C_frequency, phase in=90) -> (sine wave=w3)
  call "Sine Waveform.gvi"(sample rate=$M_sample_rate, samples=$M_samples, amplitude=$M_amplitude, frequency=$M_frequency, phase in=90) -> (sine wave=w4)
  Waveform Multiply(w4, w3) -> w5
  Waveform Add(w5, w1) -> w6
  $AM_signal <- w6
  call "Power Spectral Density for 1 Chan.gvi"(signal=w6) -> (power spectral density=w7)
  $"AM power spectrum" <- w7
  $message_signal <- w4
  call "Power Spectral Density for 1 Chan.gvi"(signal=w4) -> (power spectral density=w8)
  $"message power spectrum" <- w8
