vi "DataTypes.gvi"   [LabVIEW NXG 3.1.0]
panel controls:
  "Input String": string
panel indicators:
  "Name in": u8[]
  "Converted output": f64[]
  "Average Temp (C)": f64
  "Hot?": bool
diagram:
  String To Byte Array(string=$"Input String") -> (unsigned byte array=w1)
  $"Name in" <- w1
  Subtract(x=w1, y=32) -> w2
  Divide(x=w2, y=1.8) -> w3
  $"Converted output" <- w3
  Array Size(array=w3) -> (size(s)=w4)
  Add Array Elements(numeric array=w3) -> (sum=w5)
  Divide(x=w5, y=w4) -> w6
  $"Average Temp (C)" <- w6
  Is Greater Or Equal(x=w6, y=50) -> w7
  $"Hot?" <- w7
