vi "AMTopLevel.gvi"   [LabVIEW NXG 3.1.0]
panel controls:
  "M_amplitude": f64 = 1
  "M_frequency": f64 = 10
  "C_amplitude": f64 = 1
  "C_frequency": f64 = 10
  "M_sample_rate": f64 = 1000
  "M_samples": i32 = 1000
  "C_sample_rate": f64 = 1000
  "C_samples": i32 = 1000
  "stop": bool
  "cutoff frequency": f64 = 0.125
  "order": i32 = 2
panel indicators:
  "message signal": waveform<f64>
  "AM signal": waveform<f64>
  "Envelope message signal": waveform<f64>
  "Envelope message PSD": T1
  "Coherent message signal": waveform<f64>
  "Coherent message PSD": T1
types:
  T1 = cluster{"f0": f64, "df": f64, "magnitude": f64[]}
diagram:
  while {
    call "AM.gvi"(M_sample_rate=$M_sample_rate, M_samples=$M_samples, C_sample_rate=$C_sample_rate, C_samples=$C_samples, M_amplitude=$M_amplitude, M_frequency=$M_frequency, C_amplitude=$C_amplitude, C_frequency=$C_frequency) -> (message_signal=w1, carrier_signal=w2, AM_signal=w3)
    $"message signal" <- w1
    call "AMCoherent.gvi"(AM signal=w3, carrier signal=w2, cutoff frequency=$"cutoff frequency", order=$order) -> (message signal=w4, message PSD=w5)
    $"Coherent message signal" <- w4
    $"Coherent message PSD" <- w5
    $"AM signal" <- w3
    call "AMEnvelopeDetection.gvi"(AM signal=w3, cutoff frequency=$"cutoff frequency", order=$order) -> (message signal=w6, message PSD=w7)
    $"Envelope message signal" <- w6
    $"Envelope message PSD" <- w7
    stop if $stop
  }
