vi "AMEnvelopeDetection.gvi"   [LabVIEW NXG 3.1.0]
inputs:
  "AM signal": waveform<f64> = {dt=1, Y=[]}
  "cutoff frequency": f64 = 0.125
  "order": i32 = 2
outputs:
  "message signal": waveform<f64>
  "message PSD": T1
panel indicators:
  "Output": f64[]
types:
  T1 = cluster{"f0": f64, "df": f64, "magnitude": f64[]}
uses:
  NI::Analysis::Filtering::Butterworth Lowpass Filter (Waveform).gvi
  NI::Analysis::Measurement::AC DC and RMS (single-shot)(Wfm).gvi
  NI::Analysis::Measurement::Power Spectral Density for 1 Chan.gvi
diagram:
  Waveform Multiply($"AM signal", 3.14152) -> w1
  Property Node(instance in=w1) -> ("Y"=w2, "t0"=w3, "dt"=w4, "attributes"=w5)
  Array Size(array=w2) -> (size(s)=w6)
  s1 = f64[] []  # shift register
  for (N = w6) (iteration -> i1) {
    w7 = each element of w2
    Is Less Than 0(x=w7) -> w8
    case (w8) {
      frame False, Default {
        Insert Into Array(inArray=s1, index0=i1, new=w7) -> w9
      }
      frame True {
        Insert Into Array(inArray=s1, index0=i1, new=0) -> w9
      }
    }
    next s1 = w9
  }
  Build Waveform Node(Y=s1, attributes=w5, dt=w4, t0=w3) -> (output waveform=w10)
  call "Butterworth Lowpass Filter (Waveform).gvi"(signal=w10, cutoff frequency=$"cutoff frequency", order=$order) -> (filtered signal=w11)
  call "AC DC and RMS (single-shot)(Wfm).gvi"(signal=w11) -> (DC value=w12)
  Waveform Subtract(x=w11, y=w12) -> w13
  $"message signal" <- w13
  call "Power Spectral Density for 1 Chan.gvi"(signal=w13) -> (power spectral density=w14)
  $"message PSD" <- w14
  $Output <- s1
