vi "FMDemodulator.gvi"   [LabVIEW NXG 3.1.0]
inputs:
  "modulated signal": waveform<f64> = {dt=1, Y=[]}
  "carrier amplitude": f64
  "Kf": f64
  "cutoff frequency": f64 = 0.125
  "order": i32 = 2
outputs:
  "demodulated signal": waveform<f64>
  "demodulated PSD": T1
types:
  T1 = cluster{"f0": f64, "df": f64, "magnitude": f64[]}
uses:
  NI::Analysis::IntegralDifferentiation::Derivative x(t).gvi
  NI::Analysis::Measurement::Power Spectrum for 1 Chan.gvi
diagram:
  Property Node(instance in=$"modulated signal") -> ("Y"=w1, "t0"=w2, "dt"=w3, "attributes"=w4)
  call "Derivative x(t).gvi"(dt=w3, x(t)=w1) -> (dx(t)/dt=w5)
  Build Waveform Node(Y=w5, attributes=w4, dt=w3, t0=w2) -> (output waveform=w6)
  call "AMEnvelopeDetection.gvi"(AM signal=w6, cutoff frequency=$"cutoff frequency", order=$order) -> (message signal=w7)
  Multiply($"carrier amplitude", $Kf) -> w8
  Multiply(w8, f64 default) -> w9
  Waveform Divide(x=w7, y=w9) -> w10
  $"demodulated signal" <- w10
  call "Power Spectrum for 1 Chan.gvi"(signal=w10) -> (power spectrum=w11)
  $"demodulated PSD" <- w11
