vi "FMModulator.gvi"   [LabVIEW NXG 3.1.0]
inputs:
  "message amplitude": f64 = 1
  "message frequency": f64 = 10
  "carrier amplitude": f64 = 1
  "carrier frequency": f64 = 10
  "sample rate": f64 = 1000
  "samples": i32 = 1000
  "Kf": f64
outputs:
  "message signal": waveform<f64>
  "message PSD": T1
  "modulated signal": waveform<f64>
  "modulated PSD": T1
types:
  T1 = cluster{"f0": f64, "df": f64, "magnitude": f64[]}
uses:
  NI::Analysis::Generation::Sine Waveform.gvi
  NI::Analysis::Measurement::Power Spectrum for 1 Chan.gvi
  NI::Analysis::IntegralDifferentiation::Integral x(t).gvi
diagram:
  call "Sine Waveform.gvi"(sample rate=$"sample rate", samples=$samples, amplitude=$"message amplitude", frequency=$"message frequency") -> (sine wave=w1)
  call "Power Spectrum for 1 Chan.gvi"(signal=w1) -> (power spectrum=w2)
  $"message PSD" <- w2
  $"message signal" <- w1
  call "Sine Waveform.gvi"(sample rate=$"sample rate", samples=$samples, amplitude=$"carrier amplitude", frequency=$"carrier frequency", phase in=90) -> (sine wave=w3)
  Property Node(instance in=w1) -> ("Y"=w4, "t0"=w5, "dt"=w6, "attributes"=w7)
  call "Integral x(t).gvi"(dt=w6, x(t)=w4) -> (integral x(t)=w8)
  Multiply($Kf, f64 default) -> w9
  Multiply(w9, w8) -> w10
  Sine And Cosine(x=w10) -> (cos(x)=w11, sin(x)=w12)
  Build Waveform Node(Y=w11, attributes=w7, dt=w6, t0=w5) -> (output waveform=w13)
  Waveform Multiply(w13, w3) -> w14
  call "Sine Waveform.gvi"(sample rate=$"sample rate", samples=$samples, amplitude=$"carrier amplitude", frequency=$"carrier frequency") -> (sine wave=w15)
  Build Waveform Node(Y=w12, attributes=w7, dt=w6, t0=w5) -> (output waveform=w16)
  Waveform Multiply(w16, w15) -> w17
  Waveform Subtract(x=w14, y=w17) -> w18
  $"modulated signal" <- w18
  call "Power Spectrum for 1 Chan.gvi"(signal=w18) -> (power spectrum=w19)
  $"modulated PSD" <- w19
