vi "FMTopLevel.gvi"   [LabVIEW NXG 3.1.0]
panel controls:
  "message amplitude": f64 = 1
  "message frequency": f64 = 10
  "carrier amplitude": f64 = 1
  "carrier frequency": f64 = 10
  "sample rate": f64 = 1000
  "samples": i32 = 1000
  "Kf": f64
  "cutoff frequency": f64 = 0.125
  "order": i32 = 2
panel indicators:
  "demodulated signal": waveform<f64>
  "message signal": waveform<f64>
  "demodulated PSD": T1
  "message PSD": T1
types:
  T1 = cluster{"f0": f64, "df": f64, "magnitude": f64[]}
diagram:
  call "FMModulator.gvi"(sample rate=$"sample rate", samples=$samples, Kf=$Kf, message amplitude=$"message amplitude", message frequency=$"message frequency", carrier amplitude=$"carrier amplitude", carrier frequency=$"carrier frequency") -> (message signal=w1, message PSD=w2, modulated signal=w3)
  $"message signal" <- w1
  $"message PSD" <- w2
  call "FMDemodulator.gvi"(cutoff frequency=$"cutoff frequency", order=$order, modulated signal=w3, carrier amplitude=$"carrier amplitude", Kf=$Kf) -> (demodulated signal=w4, demodulated PSD=w5)
  $"demodulated signal" <- w4
  $"demodulated PSD" <- w5
