vi "BPSK_Tx_Rx_Template.gvi"   [LabVIEW NXG 3.1.0]
panel controls:
  "IQ rate": f64 = 200000
  "device names": "USRP niUSRPClass"
  "carrier frequency": f64 = 400000000
  "gain Tx": f64
  "active antenna Tx": string = "TX1"
  "stop Tx": bool
  "gain Rx": f64
  "active antenna Rx": string = "RX2"
  "total bits": i32 = 128
  "symbol rate": f64
panel indicators:
  "Baseband Waveform": waveform<f64>
  "Baseband Power Spectrum_Tx": T1
  "Baseband Power Spectrum_Rx": T1
types:
  T1 = cluster{"f0": f64, "df": f64, "magnitude": f64[]}
uses:
  NI::Modulation::MT Generate Bits (Fibonacci, PN Order).gvi
  NI::Analysis::Resampling::Upsample (DBL).gvi
  NI::Modulation::MT Generate Filter Coefficients.gvi
  NI::USRP::niUSRP Open Rx Session.gvi
  NI::USRP::niUSRP Configure Signal.gvi
  NI::USRP::niUSRP Initiate.gvi
  NI::USRP::niUSRP Fetch Rx Data (CDB).gvi
  NI::USRP::niUSRP Close Session.gvi
  NI::USRP::niUSRP Open Tx Session.gvi
  NI::USRP::niUSRP Write Tx Data (CDB).gvi
diagram:
  call "MT Generate Bits (Fibonacci, PN Order).gvi"(total bits=$"total bits") -> (output bit stream=w1)
  Array Size(array=w1) -> (size(s)=w2)
  s1 = f64[] []  # shift register
  for (N = w2) (iteration -> i1) {
    w3 = each element of w1
    Is Equal To 0(x=w3) -> w4
    Select(s=w4, t=-1, f=1) -> w5
    Insert Into Array(inArray=s1, index0=i1, new=w5) -> w6
    next s1 = w6
  }
  call "AddFrameHeader.gvi"(array=s1) -> (output array=w7)
  Divide(x=$"IQ rate", y=$"symbol rate") -> w8
  To Long Integer(number=w8) -> w9
  call "Upsample (DBL).gvi"(signal=w7, upsampling factor=w9)
  # Transmitter
  call "MT Generate Filter Coefficients.gvi"(pulse shaping filter="Root Raised Cos", pulse shaping samples per symbol=w9, modulation type="PSK")
  w10 = cluster{"t0": timestamp, "dt": f64, "Y": c128[]} {all zero or empty}
  Property Node(instance in=w10) -> (instance out=w11)
  call "FFT Power Spectrum for 1 Chan (CDB)2.gvi"(time signal=w11, dB On (F)=TRUE) -> (power spectrum=w12)
  $"Baseband Power Spectrum_Rx" <- w12
  Build Waveform Node() -> (output waveform=w13)
  $"Baseband Waveform" <- w13
  # Receiver
  call "niUSRP Open Rx Session.gvi"(device names=$"device names") -> (session handle out=w14, error out=w15)
  call "niUSRP Configure Signal.gvi"(active antenna=$"active antenna Rx", session handle=w14, error in=w15, IQ rate=$"IQ rate", carrier frequency=$"carrier frequency", gain=$"gain Rx") -> (session handle out=w16, error out=w17, coerced carrier frequency=w18)
  Subtract(x=w18, y=20000) -> w19
  Property Node(instance in=w16, "niUSRP"=w19) -> (instance out=w20)
  call "niUSRP Initiate.gvi"(session handle=w20, error in=w17) -> (session handle out=w21, error out=w22)
  call "niUSRP Fetch Rx Data (CDB).gvi"(session handle=w21, error in=w22, number of samples=1000000) -> (session handle out=w23, error out=w24)
  call "niUSRP Close Session.gvi"(session handle=w23, error in=w24)
  w25 = cluster{"t0": timestamp, "dt": f64, "Y": c128[]} {all zero or empty}
  Property Node(instance in=w25) -> (instance out=w26)
  call "FFT Power Spectrum for 1 Chan (CDB)2.gvi"(time signal=w26, dB On (F)=TRUE) -> (power spectrum=w27)
  $"Baseband Power Spectrum_Tx" <- w27
  call "niUSRP Open Tx Session.gvi"(device names=$"device names") -> (session handle out=w28, error out=w29)
  call "niUSRP Configure Signal.gvi"(active antenna=$"active antenna Tx", session handle=w28, error in=w29, IQ rate=$"IQ rate", carrier frequency=$"carrier frequency", gain=$"gain Tx") -> (session handle out=w30, error out=w31)
  while {
    call "niUSRP Write Tx Data (CDB).gvi"(session handle=w30, error in=w31) -> (session handle out=w32, error out=w33)
    stop if $"stop Tx"
  }
  call "niUSRP Close Session.gvi"(session handle=w32, error in=w33)
